# Dynamo graph stadion_warsztaty.dyn (Dynamo 1.3.4.6666)

# group: parametry stadionu
x = IntegerSlider(130, range=20..130 step 1)
y = IntegerSlider(80, range=30..100 step 1)
n = IntegerSlider(39, range=30..101 step 1)
z = IntegerSlider(52, range=30..100 step 1)

# group: tworzenie bazowego kształtu
code_block = CodeBlock(x=x, y=y) { {x,-x,-x,x}; {y,y,-y,-y}; }
byCoordinates = Point.ByCoordinates(x=code_block.out0, y=code_block.out1)
code_block_2 = CodeBlock { true; }
byPoints = NurbsCurve.ByPoints(byCoordinates, code_block_2)
byControlPoints = NurbsCurve.ByControlPoints(byCoordinates, arg2=code_block_2)

code_block_3 = CodeBlock(n=n) { 0..1..#n; }

# group: konstrukcja właściwa
pointAtParameter = Curve.PointAtParameter(curve=byPoints, param=code_block_3)
normalAtParameter = Curve.NormalAtParameter(curve=byPoints, param=code_block_3)
odsunięcie_od_krzywej_bazowej = CodeBlock { -10; -40; }
scale = Vector.Scale(vector=normalAtParameter, scale_factor=odsunięcie_od_krzywej_bazowej.out1)
wysokości_cześci = CodeBlock(z=z) { 7/10*z; z; }
byCoordinates_2 = Vector.ByCoordinates(z=wysokości_cześci.z)
add = Vector.Add(scale, byCoordinates_2, lacing=CrossProduct)
translate = Geometry.Translate(geometry=pointAtParameter, direction=add)
byStartPointEndPoint = Line.ByStartPointEndPoint(startPoint=pointAtParameter, endPoint=translate)
byCoordinates_3 = Vector.ByCoordinates(z=wysokości_cześci.out0)
scale_2 = Vector.Scale(vector=normalAtParameter, scale_factor=odsunięcie_od_krzywej_bazowej.out0)
add_2 = Vector.Add(byCoordinates_3, scale_2, lacing=CrossProduct)
translate_2 = Geometry.Translate(geometry=pointAtParameter, direction=add_2)
byStartPointEndPoint_2 = Line.ByStartPointEndPoint(startPoint=translate_2, endPoint=translate)
byStartPointEndPoint_3 = Line.ByStartPointEndPoint(startPoint=pointAtParameter, endPoint=translate_2)

code_block_4 = CodeBlock { true; }
byPoints_2 = NurbsCurve.ByPoints(translate_2, code_block_4)

# group: odsunięcie od bazowej dachu
code_block_5 = CodeBlock { 5; }
offset = Curve.Offset(curve=byPoints_2, distance=code_block_5)

# group: iglica
byCoordinates_4 = Point.ByCoordinates(z=z)
byStartPointEndPoint_4 = Line.ByStartPointEndPoint(startPoint=byCoordinates_4, endPoint=translate_2)

ZAxis = Vector.ZAxis()
project = Curve.Project(curve=byControlPoints, baseGeometry=byStartPointEndPoint_4, projectionDirection=ZAxis)
flatten = Flatten(project)
code_block_6 = CodeBlock { true; }
byPoints_3 = NurbsCurve.ByPoints(flatten, code_block_6)

# group: powierzchnia dachu
join = List.Join(offset, byPoints_3)
byLoft = Surface.ByLoft(join)

# group: elewacja
join_2 = List.Join(offset, byPoints)
byLoft_2 = Surface.ByLoft(join_2)
